# Grasshopper definition Embed Test.gh (Grasshopper 1.0.7)
# plug-ins: Urbano

panel = Panel("http://climate.onebuilding.org/WMO_Region_4_North_and_Central_America/USA_United_States_of_America/PA_Pennsylvania/USA_PA_Philadelphia-Northeast.Philadelphia.AP.724085_TMY3.zip")
# Import EPW
boolean_toggle = BooleanToggle(False)
epwmap = LBEPWmap(epw_map=boolean_toggle)  # -> Output; plug-in component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
downloadepw = LBDownloadWeather(weather_URL=panel)  # -> epw_file, stat_file, ddy_file; plug-in component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
importepw = LBImportEPW(epw_file=downloadepw.epw_file)  # -> location, dry_bulb_temperature, dew_point_temperature, relative_humidity, wind_speed, wind_direction, direct_normal_rad, diffuse_horizontal_rad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; plug-in component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

tree_coverage = Brep([<brep referenced from the Rhino model> x54])
aoi_lots = Brep([<brep referenced from the Rhino model> x2])
all_lots = Brep([<brep referenced from the Rhino model> x35])
context_buildings = Brep([<brep referenced from the Rhino model> x100])
aoi_buildings = Brep([<brep referenced from the Rhino model> x73])  # disabled
all_buildings = Brep([<brep referenced from the Rhino model> x173])  # disabled
streets = Brep(<brep referenced from the Rhino model>)  # disabled

# ----
# Finding the Extreme Hot and Cold Week
importstat = LBImportSTAT(stat_file=downloadepw.stat_file)  # -> location, ashrae_zone, koppen_zone, clear_dir_norm_rad, clear_diff_horiz_rad, ann_heat_dday_996, ann_heat_dday_990, ann_cool_dday_004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; plug-in component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
panel_2 = Panel(importstat.extreme_hot_week)
panel_3 = Panel(importstat.extreme_cold_week)

analysisperiod = LBAnalysisPeriod(start_month="1", start_day="1", start_hour=0, end_month="12", end_day="31")  # -> period, hoys, dates; plug-in component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

hb_building_programs = HBBuildingPrograms({"LargeOffice", "MediumOffice", "SmallOffice", "MidriseApartment", "HighriseApartment", "Retail", "StripMall", "PrimarySchool", "SecondarySchool", "SmallHotel", "LargeHotel", "Hospital", "Outpatient", "Laboratory", "Warehouse", "SuperMarket", "FullServiceRestaurant", "QuickServiceRestaurant", "Courthouse", "LargeDataCenterHighITE", "LargeDataCenterLowITE", "SmallDataCenterHighITE", "SmallDataCenterLowITE"}, selected="LargeOffice")  # disabled
panel_4 = Panel("PrimarySchool")  # disabled
boolean_toggle_2 = BooleanToggle(True)  # disabled
primaryschool = Brep([<brep referenced from the Rhino model> x3])  # disabled
panel_5 = Panel("@6")  # disabled
buildingsolid = DFBuildingFromSolid(
    bldg_geo=flatten(primaryschool),
    floor_to_floor=panel_5,
    name=panel_4,
    program=hb_building_programs,
    run=boolean_toggle_2)  # -> out, buildings; disabled; plug-in component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

hb_building_programs_2 = HBBuildingPrograms({"LargeOffice", "MediumOffice", "SmallOffice", "MidriseApartment", "HighriseApartment", "Retail", "StripMall", "PrimarySchool", "SecondarySchool", "SmallHotel", "LargeHotel", "Hospital", "Outpatient", "Laboratory", "Warehouse", "SuperMarket", "FullServiceRestaurant", "QuickServiceRestaurant", "Courthouse", "LargeDataCenterHighITE", "LargeDataCenterLowITE", "SmallDataCenterHighITE", "SmallDataCenterLowITE"}, selected="Retail")  # disabled
boolean_toggle_3 = BooleanToggle(True)  # disabled
panel_6 = Panel("Retail")  # disabled
panel_7 = Panel("@3")  # disabled
retail = Brep([<brep referenced from the Rhino model> x3])  # disabled
buildingsolid_2 = DFBuildingFromSolid(bldg_geo=flatten(retail), floor_to_floor=panel_7, name=panel_6, program=hb_building_programs_2, run=boolean_toggle_3)  # -> out, buildings; disabled; plug-in component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

hb_building_programs_3 = HBBuildingPrograms({"LargeOffice", "MediumOffice", "SmallOffice", "MidriseApartment", "HighriseApartment", "Retail", "StripMall", "PrimarySchool", "SecondarySchool", "SmallHotel", "LargeHotel", "Hospital", "Outpatient", "Laboratory", "Warehouse", "SuperMarket", "FullServiceRestaurant", "QuickServiceRestaurant", "Courthouse", "LargeDataCenterHighITE", "LargeDataCenterLowITE", "SmallDataCenterHighITE", "SmallDataCenterLowITE"}, selected="Warehouse")  # disabled
boolean_toggle_4 = BooleanToggle(True)  # disabled
panel_8 = Panel("Church")  # disabled
church = Brep(<brep referenced from the Rhino model>)  # disabled
panel_9 = Panel("@6")  # disabled
buildingsolid_3 = DFBuildingFromSolid(bldg_geo=flatten(church), floor_to_floor=panel_9, name=panel_8, program=hb_building_programs_3, run=boolean_toggle_4)  # -> out, buildings; disabled; plug-in component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

brep = Brep([<brep referenced from the Rhino model> x2])  # disabled
brep_2 = Brep([<brep referenced from the Rhino model> x2])
aoi_site = Brep(<brep referenced from the Rhino model>)

# ----
# Generate Points
number_slider = Slider(10, range=0..10)
genpts = LBGeneratePointGrid(geometry=aoi_site, grid_size=number_slider, offset_dist="0.1")  # -> points, vectors, face_areas, graft(mesh); disabled; plug-in component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

smallhotel = Brep([<brep referenced from the Rhino model> x157])  # disabled
hb_building_programs_4 = HBBuildingPrograms({"LargeOffice", "MediumOffice", "SmallOffice", "MidriseApartment", "HighriseApartment", "Retail", "StripMall", "PrimarySchool", "SecondarySchool", "SmallHotel", "LargeHotel", "Hospital", "Outpatient", "Laboratory", "Warehouse", "SuperMarket", "FullServiceRestaurant", "QuickServiceRestaurant", "Courthouse", "LargeDataCenterHighITE", "LargeDataCenterLowITE", "SmallDataCenterHighITE", "SmallDataCenterLowITE"}, selected="SmallHotel")  # disabled
boolean_toggle_5 = BooleanToggle(True)  # disabled
panel_10 = Panel("SmallHotel")  # disabled
panel_11 = Panel("@3")  # disabled
buildingsolid_4 = DFBuildingFromSolid(
    bldg_geo=flatten([smallhotel, brep]),
    floor_to_floor=panel_11,
    name=panel_10,
    program=hb_building_programs_4,
    run=boolean_toggle_5)  # -> out, buildings; disabled; plug-in component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

hb_building_programs_5 = HBBuildingPrograms({"LargeOffice", "MediumOffice", "SmallOffice", "MidriseApartment", "HighriseApartment", "Retail", "StripMall", "PrimarySchool", "SecondarySchool", "SmallHotel", "LargeHotel", "Hospital", "Outpatient", "Laboratory", "Warehouse", "SuperMarket", "FullServiceRestaurant", "QuickServiceRestaurant", "Courthouse", "LargeDataCenterHighITE", "LargeDataCenterLowITE", "SmallDataCenterHighITE", "SmallDataCenterLowITE"}, selected="Warehouse")  # disabled
panel_12 = Panel("Garage")  # disabled
boolean_toggle_6 = BooleanToggle(True)  # disabled
garages = Brep([<brep referenced from the Rhino model> x5])  # disabled
panel_13 = Panel("@6")  # disabled
buildingsolid_5 = DFBuildingFromSolid(bldg_geo=flatten(garages), floor_to_floor=panel_13, name=panel_12, program=hb_building_programs_5, run=boolean_toggle_6)  # -> out, buildings; disabled; plug-in component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

smallhotel_2 = Brep([<brep referenced from the Rhino model> x157])
hb_building_programs_6 = HBBuildingPrograms({"LargeOffice", "MediumOffice", "SmallOffice", "MidriseApartment", "HighriseApartment", "Retail", "StripMall", "PrimarySchool", "SecondarySchool", "SmallHotel", "LargeHotel", "Hospital", "Outpatient", "Laboratory", "Warehouse", "SuperMarket", "FullServiceRestaurant", "QuickServiceRestaurant", "Courthouse", "LargeDataCenterHighITE", "LargeDataCenterLowITE", "SmallDataCenterHighITE", "SmallDataCenterLowITE"}, selected="SmallHotel")
buildingsolid_6 = DFBuildingFromSolid(
    bldg_geo=flatten([smallhotel_2, brep_2]),
    floor_to_floor="@3",
    name="SmallHotel",
    program=hb_building_programs_6,
    run=Toggle(True))  # -> out, buildings; plug-in component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

hb_building_programs_7 = HBBuildingPrograms({"LargeOffice", "MediumOffice", "SmallOffice", "MidriseApartment", "HighriseApartment", "Retail", "StripMall", "PrimarySchool", "SecondarySchool", "SmallHotel", "LargeHotel", "Hospital", "Outpatient", "Laboratory", "Warehouse", "SuperMarket", "FullServiceRestaurant", "QuickServiceRestaurant", "Courthouse", "LargeDataCenterHighITE", "LargeDataCenterLowITE", "SmallDataCenterHighITE", "SmallDataCenterLowITE"}, selected="Outpatient")
outpatient = Brep(<brep referenced from the Rhino model>)
buildingsolid_7 = DFBuildingFromSolid(bldg_geo=flatten(outpatient), floor_to_floor="@6", name="Outpatient", program=hb_building_programs_7, run=Toggle(True))  # -> out, buildings; plug-in component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

hb_building_programs_8 = HBBuildingPrograms({"LargeOffice", "MediumOffice", "SmallOffice", "MidriseApartment", "HighriseApartment", "Retail", "StripMall", "PrimarySchool", "SecondarySchool", "SmallHotel", "LargeHotel", "Hospital", "Outpatient", "Laboratory", "Warehouse", "SuperMarket", "FullServiceRestaurant", "QuickServiceRestaurant", "Courthouse", "LargeDataCenterHighITE", "LargeDataCenterLowITE", "SmallDataCenterHighITE", "SmallDataCenterLowITE"}, selected="Warehouse")
garages_minus = Brep([<brep referenced from the Rhino model> x3])
buildingsolid_8 = DFBuildingFromSolid(bldg_geo=flatten(garages_minus), floor_to_floor="@6", name="Garage", program=hb_building_programs_8, run=Toggle(True))  # -> out, buildings; plug-in component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

hb_building_programs_9 = HBBuildingPrograms({"LargeOffice", "MediumOffice", "SmallOffice", "MidriseApartment", "HighriseApartment", "Retail", "StripMall", "PrimarySchool", "SecondarySchool", "SmallHotel", "LargeHotel", "Hospital", "Outpatient", "Laboratory", "Warehouse", "SuperMarket", "FullServiceRestaurant", "QuickServiceRestaurant", "Courthouse", "LargeDataCenterHighITE", "LargeDataCenterLowITE", "SmallDataCenterHighITE", "SmallDataCenterLowITE"}, selected="LargeOffice")
primaryschool_2 = Brep([<brep referenced from the Rhino model> x3])
buildingsolid_9 = DFBuildingFromSolid(
    bldg_geo=flatten(primaryschool_2),
    floor_to_floor="@6",
    name="PrimarySchool",
    program=hb_building_programs_9,
    run=Toggle(True))  # -> out, buildings; plug-in component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

hb_building_programs_10 = HBBuildingPrograms({"LargeOffice", "MediumOffice", "SmallOffice", "MidriseApartment", "HighriseApartment", "Retail", "StripMall", "PrimarySchool", "SecondarySchool", "SmallHotel", "LargeHotel", "Hospital", "Outpatient", "Laboratory", "Warehouse", "SuperMarket", "FullServiceRestaurant", "QuickServiceRestaurant", "Courthouse", "LargeDataCenterHighITE", "LargeDataCenterLowITE", "SmallDataCenterHighITE", "SmallDataCenterLowITE"}, selected="Warehouse")
church_2 = Brep(<brep referenced from the Rhino model>)
buildingsolid_10 = DFBuildingFromSolid(bldg_geo=flatten(church_2), floor_to_floor="@6", name="Church", program=hb_building_programs_10, run=Toggle(True))  # -> out, buildings; plug-in component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

retail_2 = Brep([<brep referenced from the Rhino model> x3])

hb_building_programs_11 = HBBuildingPrograms({"LargeOffice", "MediumOffice", "SmallOffice", "MidriseApartment", "HighriseApartment", "Retail", "StripMall", "PrimarySchool", "SecondarySchool", "SmallHotel", "LargeHotel", "Hospital", "Outpatient", "Laboratory", "Warehouse", "SuperMarket", "FullServiceRestaurant", "QuickServiceRestaurant", "Courthouse", "LargeDataCenterHighITE", "LargeDataCenterLowITE", "SmallDataCenterHighITE", "SmallDataCenterLowITE"}, selected="Retail")
buildingsolid_11 = DFBuildingFromSolid(bldg_geo=flatten(retail_2), floor_to_floor="@3", name="Retail", program=hb_building_programs_11, run=Toggle(True))  # -> out, buildings; plug-in component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

panel_14 = Panel("7")  # disabled
panel_15 = Panel("7")  # disabled
panel_16 = Panel("21")  # disabled
panel_17 = Panel("15")  # disabled
panel_18 = Panel("7")  # disabled

# ----
# Select Roof (not applicable - we are focusing on lots & ground temperatures)
deconstruct_brep = DeconstructBrep()  # -> Faces, Edges, Vertices; disabled
number_slider_2 = Slider(3, range=0..5)  # disabled
list_item = ListItem(List=deconstruct_brep.Faces, Index=number_slider_2, Wrap=True)  # disabled

panel_19 = Panel("0.1")  # disabled

# ----
# Brep Choices
tree_coverage_2 = Brep([<brep referenced from the Rhino model> x54])
aoi_lots_2 = Brep([<brep referenced from the Rhino model> x2])
all_lots_2 = Brep([<brep referenced from the Rhino model> x35])
context_buildings_2 = Brep([<brep referenced from the Rhino model> x100])
aoi_buildings_2 = Brep([<brep referenced from the Rhino model> x73])
all_buildings_2 = Brep([<brep referenced from the Rhino model> x173])
streets_2 = Brep(<brep referenced from the Rhino model>)

tree_coverage_3 = Brep([<brep referenced from the Rhino model> x54])  # disabled
all_buildings_3 = Brep([<brep referenced from the Rhino model> x173])  # disabled

boolean_toggle_7 = BooleanToggle(True)  # disabled
panel_20 = Panel("1.8")  # disabled
humantosky = LBHumanToSkyRelation(
    location=importepw.location,
    position=flatten(genpts.points),
    context=flatten([all_buildings_3, tree_coverage_3]),
    height=panel_20,
    run=boolean_toggle_7)  # -> out, human_points, human_line, fract_body_exp, sky_exposure; disabled; plug-in component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
boolean_toggle_8 = BooleanToggle(True)  # disabled
outdoorsolarmrt = LBOutdoorSolarMRT(
    location=importepw.location,
    surface_temp=importepw.dry_bulb_temperature,
    dir_norm_rad=importepw.direct_normal_rad,
    diff_horiz_rad=importepw.diffuse_horizontal_rad,
    horiz_infrared=importepw.horizontal_infrared_rad,
    sky_exposure=humantosky.sky_exposure,
    run=boolean_toggle_8)  # -> out, short_erf, long_erf, short_dmrt, long_dmrt, mrt; disabled; plug-in component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
boolean_toggle_9 = BooleanToggle(True)  # disabled
utci = LBUTCIComfort(
    air_temp=importepw.dry_bulb_temperature,
    mrt=outdoorsolarmrt.mrt,
    rel_humid=importepw.relative_humidity,
    wind_vel=importepw.wind_speed,
    run=boolean_toggle_9)  # -> out, utci, comfort, condition, category, comf_obj; disabled; plug-in component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

tree_coverage_4 = Brep([<brep referenced from the Rhino model> x54])  # disabled
all_buildings_4 = Brep([<brep referenced from the Rhino model> x173])  # disabled
aoi_lots_3 = Brep([<brep referenced from the Rhino model> x2])  # disabled

# ----
# Solar Radiation
number_slider_3 = Slider(10, range=0..10)  # disabled
boolean_toggle_10 = BooleanToggle(False)  # disabled
skymatrix = LBCumulativeSkyMatrix(
    location=importepw.location,
    direct_rad=importepw.direct_normal_rad,
    diffuse_rad=importepw.diffuse_horizontal_rad,
    hoys=analysisperiod.hoys)  # -> out, sky_mtx; disabled; plug-in component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
incidentradiation = LBIncidentRadiation(
    sky_mtx=skymatrix.sky_mtx,
    geometry=flatten(aoi_lots_3),
    context=flatten(tree_coverage_4),
    grid_size=number_slider_3,
    offset_dist=panel_19,
    run=boolean_toggle_10)  # -> out, points, results, total, mesh, legend, title, int_mtx; disabled; plug-in component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
average = Average(Input=incidentradiation.results)  # disabled

tree_coverage_5 = Brep([<brep referenced from the Rhino model> x54])
all_buildings_5 = Brep([<brep referenced from the Rhino model> x173])
tree_coverage_6 = Brep([<brep referenced from the Rhino model> x54])

panel_21 = Panel("Warehouse")  # disabled
number_slider_4 = Slider(0, range=0..1)  # disabled
panel_22 = Panel("1980_Present")  # disabled
buildinguwg = DFAssignBuildingUWGProperties(building=buildingsolid_2.buildings, program=panel_21, vintage=panel_22, roof_veg=number_slider_4)  # -> out, building; disabled; plug-in component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

panel_23 = Panel("Warehouse")  # disabled
number_slider_5 = Slider(0, range=0..1)  # disabled
panel_24 = Panel("1980_Present")  # disabled
buildinguwg_2 = DFAssignBuildingUWGProperties(building=buildingsolid.buildings, program=panel_23, vintage=panel_24, roof_veg=number_slider_5)  # -> out, building; disabled; plug-in component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

panel_25 = Panel("SmallHotel")  # disabled
number_slider_6 = Slider(0, range=0..1)  # disabled
panel_26 = Panel("1980_Present")  # disabled
buildinguwg_3 = DFAssignBuildingUWGProperties(building=buildingsolid_3.buildings, program=panel_25, vintage=panel_26, roof_veg=number_slider_6)  # -> out, building; disabled; plug-in component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

tree_coverage_added = Brep([<brep referenced from the Rhino model> x103])  # disabled
tree_coverage_added_2 = Brep([<brep referenced from the Rhino model> x103])  # disabled

panel_27 = Panel("Warehouse")  # disabled
number_slider_7 = Slider(0, range=0..1)  # disabled
panel_28 = Panel("1980_Present")  # disabled
buildinguwg_4 = DFAssignBuildingUWGProperties(building=buildingsolid_5.buildings, program=panel_27, vintage=panel_28, roof_veg=number_slider_7)  # -> out, building; disabled; plug-in component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

buildinguwg_5 = DFAssignBuildingUWGProperties(building=buildingsolid_7.buildings, program="Outpatient", vintage="1980_Present", roof_veg=Slider(1, range=0..1))  # -> out, building; plug-in component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

buildinguwg_6 = DFAssignBuildingUWGProperties(building=buildingsolid_8.buildings, program="Warehouse", vintage="1980_Present", roof_veg=Slider(0, range=0..1))  # -> out, building; plug-in component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

all_buildings_6 = Brep([<brep referenced from the Rhino model> x173])  # disabled

panel_29 = Panel("SmallHotel")  # disabled
number_slider_8 = Slider(0, range=0..1)  # disabled
panel_30 = Panel("1980_Present")  # disabled
buildinguwg_7 = DFAssignBuildingUWGProperties(building=buildingsolid_4.buildings, program=panel_29, vintage=panel_30, roof_veg=number_slider_8)  # -> out, building; disabled; plug-in component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

buildinguwg_8 = DFAssignBuildingUWGProperties(building=buildingsolid_11.buildings, program="Warehouse", vintage="1980_Present", roof_veg=Slider(0.75, range=0..1))  # -> out, building; plug-in component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

buildinguwg_9 = DFAssignBuildingUWGProperties(building=buildingsolid_9.buildings, program="Warehouse", vintage="1980_Present", roof_veg=Slider(0, range=0..1))  # -> out, building; plug-in component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

buildinguwg_10 = DFAssignBuildingUWGProperties(building=buildingsolid_10.buildings, program="SmallHotel", vintage="1980_Present", roof_veg=Slider(0, range=0..1))  # -> out, building; plug-in component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

aoi_lots_4 = Brep([<brep referenced from the Rhino model> x2])

# ----
# Direct Sun Hours Lots
# Analysis Period
panel_31 = Panel("21")
analysisperiod_2 = LBAnalysisPeriod(start_month="7", start_day="15", start_hour=0, end_month="7", end_day=panel_31)  # -> period, hoys, dates; plug-in component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
sunpath = LBSunPath(location=importepw.location, hoys=analysisperiod_2.hoys, scale=1)  # -> out, vectors, altitudes, azimuths, hoys, sun_pts, analemma, daily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; plug-in component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
all_buildings_7 = Brep([<brep referenced from the Rhino model> x173])
directsunhours = LBDirectSunHours(
    vectors=flatten(sunpath.vectors),
    geometry=flatten(aoi_lots_4),
    context=flatten([all_buildings_7, tree_coverage_5]),
    grid_size=Slider(10, range=0..10),
    offset_dist="0.1",
    run=Toggle(False))  # -> out, points, results, mesh, legend, title, int_mtx; plug-in component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
panel_32 = Panel(directsunhours.results)
average_2 = Average(Input=directsunhours.results)
panel_33 = Panel(average_2)

buildinguwg_11 = DFAssignBuildingUWGProperties(building=buildingsolid_6.buildings, program="SmallHotel", vintage="1980_Present", roof_veg=Slider(0.5, range=0..1))  # -> out, building; plug-in component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

all_buildings_8 = Brep([<brep referenced from the Rhino model> x172])  # disabled
streets_3 = Brep(<brep referenced from the Rhino model>)

# ----
# Direct Sun Hours Streets
# Analysis Period
analysisperiod_3 = LBAnalysisPeriod(start_month="7", start_day="15", start_hour=0, end_month="7", end_day="21")  # -> period, hoys, dates; plug-in component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
sunpath_2 = LBSunPath(location=importepw.location, hoys=analysisperiod_3.hoys, scale=1)  # -> out, vectors, altitudes, azimuths, hoys, sun_pts, analemma, daily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; plug-in component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
directsunhours_2 = LBDirectSunHours(
    vectors=flatten(sunpath_2.vectors),
    geometry=flatten(streets_3),
    context=flatten([tree_coverage_6, all_buildings_5]),
    grid_size=Slider(10, range=0..10),
    offset_dist="0.1",
    run=Toggle(False))  # -> out, points, results, mesh, legend, title, int_mtx; plug-in component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
average_3 = Average(Input=directsunhours_2.results)
panel_34 = Panel(directsunhours_2.results)
panel_35 = Panel(average_3)

aoi_lots_5 = Brep([<brep referenced from the Rhino model> x2])  # disabled

# ----
# Direct Sun Hours Lots
# Analysis Period
panel_36 = Panel("21")  # disabled
panel_37 = Panel("15")  # disabled
panel_38 = Panel("7")  # disabled
analysisperiod_4 = LBAnalysisPeriod(start_month=panel_38, start_day=panel_37, start_hour=0, end_month=panel_14, end_day=panel_36)  # -> period, hoys, dates; disabled; plug-in component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
sunpath_3 = LBSunPath(location=importepw.location, hoys=analysisperiod_4.hoys, scale=1)  # -> out, vectors, altitudes, azimuths, hoys, sun_pts, analemma, daily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; disabled; plug-in component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
number_slider_9 = Slider(10, range=0..10)  # disabled
boolean_toggle_11 = BooleanToggle(True)  # disabled
panel_39 = Panel("0.1")  # disabled
all_buildings_9 = Brep([<brep referenced from the Rhino model> x172])  # disabled
directsunhours_3 = LBDirectSunHours(
    vectors=flatten(sunpath_3.vectors),
    geometry=flatten(aoi_lots_5),
    context=flatten([all_buildings_9, tree_coverage_added]),
    grid_size=number_slider_9,
    offset_dist=panel_39,
    run=boolean_toggle_11)  # -> out, points, results, mesh, legend, title, int_mtx; disabled; plug-in component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
panel_40 = Panel(directsunhours_3.results)  # disabled
average_4 = Average(Input=directsunhours_3.results)  # disabled
panel_41 = Panel(average_4)  # disabled

streets_4 = Brep(<brep referenced from the Rhino model>)  # disabled

# ----
# Direct Sun Hours Streets
# Analysis Period
analysisperiod_5 = LBAnalysisPeriod(start_month=panel_18, start_day=panel_17, start_hour=0, end_month=panel_15, end_day=panel_16)  # -> period, hoys, dates; disabled; plug-in component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
sunpath_4 = LBSunPath(location=importepw.location, hoys=analysisperiod_5.hoys, scale=1)  # -> out, vectors, altitudes, azimuths, hoys, sun_pts, analemma, daily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; disabled; plug-in component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
number_slider_10 = Slider(10, range=0..10)  # disabled
boolean_toggle_12 = BooleanToggle(False)  # disabled
panel_42 = Panel("0.1")  # disabled
directsunhours_4 = LBDirectSunHours(
    vectors=flatten(sunpath_4.vectors),
    geometry=flatten(streets_4),
    context=flatten([all_buildings_8, tree_coverage_added_2]),
    grid_size=number_slider_10,
    offset_dist=panel_42,
    run=boolean_toggle_12)  # -> out, points, results, mesh, legend, title, int_mtx; disabled; plug-in component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
average_5 = Average(Input=directsunhours_4.results)  # disabled
panel_43 = Panel(directsunhours_4.results)  # disabled
panel_44 = Panel(average_5)  # disabled

mesh = Mesh(incidentradiation.mesh)  # disabled
panel_45 = Panel("0.20")  # disabled
tree_coverage_added_3 = Brep([<brep referenced from the Rhino model> x103])
mesh_2 = Mesh(directsunhours.mesh)
panel_46 = Panel(average)  # disabled
tree_coverage_7 = Brep([<brep referenced from the Rhino model> x54])  # disabled
mesh_3 = Mesh(directsunhours_2.mesh)

# ----
# Solar Energy (kWh)
multiplication = Multiplication(A=average, B=panel_45)  # disabled

panel_47 = Panel(incidentradiation.results)  # disabled
mesh_4 = Mesh(directsunhours_3.mesh)  # disabled
mesh_5 = Mesh(directsunhours_4.mesh)  # disabled
panel_48 = Panel(multiplication)  # disabled
panel_49 = Panel("0.5")  # disabled
panel_50 = Panel("0.1")  # disabled
aoi_site_2 = Brep(<brep referenced from the Rhino model>)  # disabled
aoi_site_3 = Brep(<brep referenced from the Rhino model>)
number_slider_11 = Slider(0.45, range=0..1)  # disabled
panel_51 = Panel("21")  # disabled

# ----
# UTCI Simulation
# Visualize UTCI data
panel_52 = Panel("13")  # disabled
analysisperiod_6 = LBAnalysisPeriod(start_month="7", start_day=panel_51, start_hour=0, end_month="7", end_day=panel_51, end_hour=panel_52)  # -> period, hoys, dates; disabled; plug-in component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
applyper = LBApplyAnalysisPeriod(data=utci.utci, period=analysisperiod_6.period)  # -> data; disabled; plug-in component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
panel_53 = Panel(applyper)  # disabled
xdata = LBDeconstructData(data=applyper)  # -> header, flatten(values); disabled; plug-in component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
heatmap = LBSpatialHeatmap(values=xdata.values, mesh=genpts.mesh)  # -> mesh, legend, title, colors, legend_par; disabled; plug-in component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

panel_54 = Panel("21")  # disabled
panel_55 = Panel("7")  # disabled
panel_56 = Panel("15")  # disabled
panel_57 = Panel("7")  # disabled
analysisperiod_7 = LBAnalysisPeriod(start_month="7", start_day="15", start_hour=0, end_month="7", end_day="21")  # -> period, hoys, dates; plug-in component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
analysisperiod_8 = LBAnalysisPeriod(start_month=panel_57, start_day=panel_56, start_hour=0, end_month=panel_55, end_day=panel_54)  # -> period, hoys, dates; disabled; plug-in component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
analysisperiod_9 = LBAnalysisPeriod(start_month="1", start_day="1", start_hour=0, end_month="12", end_day="31")  # -> period, hoys, dates; plug-in component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

# ----
# Read UTCI data
panel_58 = Panel(utci.utci)  # disabled
xdata_2 = LBDeconstructData(data=utci.utci)  # -> header, values; disabled; plug-in component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
average_6 = Average(Input=xdata_2.values)  # disabled
panel_59 = Panel(average_6)

# ---- group: Same as first step
boolean_toggle_13 = BooleanToggle(False)  # disabled
panel_60 = Panel("http://climate.onebuilding.org/WMO_Region_4_North_and_Central_America/USA_United_States_of_America/PA_Pennsylvania/USA_PA_Philadelphia-Northeast.Philadelphia.AP.724085_TMY3.zip")  # disabled
epwmap_2 = LBEPWmap(epw_map=boolean_toggle_13)  # -> Output; disabled; plug-in component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
downloadepw_2 = LBDownloadWeather(weather_URL=panel_60)  # -> epw_file, stat_file, ddy_file; disabled; plug-in component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
importstat_2 = LBImportSTAT(stat_file=downloadepw_2.stat_file)  # -> location, ashrae_zone, koppen_zone, clear_dir_norm_rad, clear_diff_horiz_rad, ann_heat_dday_996, ann_heat_dday_990, ann_cool_dday_004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; disabled; plug-in component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

panel_61 = Panel("http://climate.onebuilding.org/WMO_Region_4_North_and_Central_America/USA_United_States_of_America/PA_Pennsylvania/USA_PA_Philadelphia-Northeast.Philadelphia.AP.724085_TMY3.zip")
epwmap_3 = LBEPWmap(epw_map=Toggle(False))  # -> Output; plug-in component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
downloadepw_3 = LBDownloadWeather(weather_URL=panel_61)  # -> epw_file, stat_file, ddy_file; plug-in component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
importstat_3 = LBImportSTAT(stat_file=downloadepw_3.stat_file)  # -> location, ashrae_zone, koppen_zone, clear_dir_norm_rad, clear_diff_horiz_rad, ann_heat_dday_996, ann_heat_dday_990, ann_cool_dday_004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; plug-in component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

# ----
panel_62 = Panel(importstat_2.extreme_hot_week)  # disabled
panel_63 = Panel(importstat_3.extreme_hot_week)
panel_64 = Panel(importstat_2.extreme_cold_week)  # disabled
panel_65 = Panel(importstat_3.extreme_cold_week)
panel_66 = Panel("21")  # disabled
panel_67 = Panel("7")  # disabled
panel_68 = Panel("15")  # disabled
panel_69 = Panel("7")  # disabled
panel_70 = Panel("21")  # disabled
panel_71 = Panel("7")  # disabled
panel_72 = Panel("15")  # disabled
panel_73 = Panel("7")  # disabled
analysisperiod_10 = LBAnalysisPeriod(start_month="7", start_day="15", start_hour=0, end_month="7", end_day="21")  # -> period, hoys, dates; plug-in component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
analysisperiod_11 = LBAnalysisPeriod(start_month=panel_69, start_day=panel_68, start_hour=0, end_month=panel_67, end_day=panel_66)  # -> period, hoys, dates; disabled; plug-in component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
analysisperiod_12 = LBAnalysisPeriod(start_month=panel_73, start_day=panel_72, start_hour=0, end_month=panel_71, end_day=panel_70)  # -> period, hoys, dates; disabled; plug-in component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
analysisperiod_13 = LBAnalysisPeriod(start_month="7", start_day="15", start_hour=0, end_month="7", end_day="21")  # -> period, hoys, dates; plug-in component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

# ----
# Import Street Tree Points
file_path = FilePath("C:\Users\victo\Documents\Pen Du's Course\Final Project\Data\PPR_StreetTrees-shp\69b39f50-460b-4b7b-b5ad-d8d9c491e4392020328-1-1vb911p.sd1c.shp")  # disabled
number_slider_12 = Slider(4, range=0..10)  # disabled
unit_z = UnitZ(Factor=number_slider_12)  # disabled
number_slider_13 = Slider(0.0762, range=0..0.1)  # disabled
panel_74 = Panel("0.0762")  # disabled

# ----
# Importing Building Footprints
# -bake polylines
# -extrude polylines to the specified heights
file_path_2 = FilePath("C:\Users\victo\Documents\Pen Du's Course\Final Project\Data\00_CarrolPark\Buildings Carrol Park\CarrollParkFootprints.shp")  # disabled
import_shapefile_features = ImportShapefileFeatures(ShapefilePath=file_path_2, Reproject=True)  # -> Points, Metadata, UTMZone, TranslationVector; disabled
panel_75 = Panel("APPROX_HGT")  # disabled
lookup_metadata = LookupMetadata(MetadataGeometry=import_shapefile_features.Metadata, SearchKey=panel_75)  # disabled
panel_76 = Panel(lookup_metadata)  # disabled

# ----
# Importing street lines
file_path_3 = FilePath("C:\Users\victo\Documents\Pen Du's Course\Final Project\Data\Curbs\Curbs.shp")  # disabled
import_shapefile_features_2 = ImportShapefileFeatures(
    ShapefilePath=file_path_3,
    Reproject=True,
    UTMZone=import_shapefile_features.UTMZone,
    TranslationVector=import_shapefile_features.TranslationVector)  # -> Points, Metadata, UTMZone, TranslationVector; disabled
polyline = PolyLine(Vertices=import_shapefile_features_2.Points, Closed=False)  # disabled

import_shapefile_features_3 = ImportShapefileFeatures(
    ShapefilePath=file_path,
    Reproject=True,
    UTMZone=import_shapefile_features_2.UTMZone,
    TranslationVector=import_shapefile_features_2.TranslationVector)  # -> Points, Metadata, UTMZone, TranslationVector; disabled
move = Move(Geometry=import_shapefile_features_3.Points, Motion=unit_z)  # -> Geometry, Transform; disabled
line = Line(StartPoint=import_shapefile_features_3.Points, EndPoint=move.Geometry)  # disabled
pipe = Pipe(Curve=line, Radius=number_slider_13, Caps=1)  # disabled

# ----
# Import tree canopy
file_path_4 = FilePath("C:\Users\victo\Documents\Pen Du's Course\Final Project\Data\RasterT_Tree_Ca1.shp")  # disabled
import_shapefile_features_4 = ImportShapefileFeatures(
    ShapefilePath=file_path_4,
    Reproject=True,
    UTMZone=import_shapefile_features_3.UTMZone,
    TranslationVector=import_shapefile_features_3.TranslationVector)  # -> Points, Metadata, UTMZone, TranslationVector; disabled
number_slider_14 = Slider(4, range=0..10)  # disabled
polyline_2 = PolyLine(Vertices=import_shapefile_features_4.Points, Closed=False)  # disabled
unit_z_2 = UnitZ(Factor=number_slider_14)  # disabled
move_2 = Move(Geometry=polyline_2, Motion=unit_z_2)  # -> Geometry, Transform; disabled
surface = Surface(move_2.Geometry)  # disabled

# ----
# Footprints
file_path_5 = FilePath("C:\Users\victo\Documents\Pen Du's Course\Final Project\Data\LI_BUILDING_FOOTPRINTS\LI_BUILDING_FOOTPRINTS.shp")  # disabled
import_shapefile_features_5 = ImportShapefileFeatures(
    ShapefilePath=file_path_5,
    Reproject=True,
    UTMZone=import_shapefile_features_4.UTMZone,
    TranslationVector=import_shapefile_features_4.TranslationVector)  # -> Points, Metadata, UTMZone, TranslationVector; disabled
polyline_3 = PolyLine(Vertices=import_shapefile_features_5.Points, Closed=False)  # disabled

# ----
# Carroll Park AOI
file_path_6 = FilePath("C:\Users\victo\Documents\Pen Du's Course\Final Project\Data\00_CarrolPark\AOI Carrol PArk\AOI_CarolPark.shp")  # disabled
import_shapefile_features_6 = ImportShapefileFeatures(
    ShapefilePath=file_path_6,
    Reproject=True,
    UTMZone=import_shapefile_features_5.UTMZone,
    TranslationVector=import_shapefile_features_5.TranslationVector)  # -> Points, Metadata, UTMZone, TranslationVector; disabled
number_slider_15 = Slider(4, range=0..10)  # disabled
polyline_4 = PolyLine(Vertices=import_shapefile_features_6.Points, Closed=False)  # disabled
unit_z_3 = UnitZ(Factor=number_slider_15)  # disabled
move_3 = Move(Geometry=polyline_4, Motion=unit_z_3)  # -> Geometry, Transform; disabled
surface_2 = Surface(move_3.Geometry)  # disabled

polyline_5 = PolyLine(Vertices=import_shapefile_features.Points, Closed=False)  # disabled

create_building = CreateBuilding(BuildingCurve=flatten(polyline_5), Metadata=flatten(import_shapefile_features.Metadata))  # disabled
inspect_building = InspectBuilding(Building=create_building, DefaultHeight=10)  # -> Geometry, Metadata, Amenity, BuildingMesh; disabled
mesh_6 = Mesh(inspect_building.BuildingMesh)  # disabled

# ----
# Urban Heat Island - Existing
boolean_toggle_14 = BooleanToggle(True)  # disabled
all_buildings_10 = Data([buildinguwg_2.building, buildinguwg_3.building, buildinguwg.building, buildinguwg_4.building, buildinguwg_7.building])  # disabled
context = DFContextShade(geo=tree_coverage_7, uwg_is_veg=boolean_toggle_14)  # -> out, context; disabled; plug-in component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
model = DFModel(buildings=flatten(all_buildings_10), context=flatten(context.context))  # -> out, model; disabled; plug-in component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
panel_77 = Panel("8")  # disabled
traffic = DFTrafficParameters(watts_per_area=panel_77)  # -> traffic; disabled; plug-in component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
terrain = DFTerrain(terrain_geo=aoi_site_2, albedo=panel_50, thickness=panel_49)  # -> terrain; disabled; plug-in component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
modeluwg = DFAssignModelUWGProperties(model=model.model, terrain=terrain, traffic=traffic, grass_cover=number_slider_11)  # -> out, model; disabled; plug-in component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
panel_78 = Panel(modeluwg.out)  # disabled
panel_79 = Panel(".5")  # disabled
boundarylayer = DFBoundaryLayerParameters()  # -> bnd_layer; disabled; plug-in component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
refepwpar = DFReferenceEPWParameters()  # -> epw_site; disabled; plug-in component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
vegetationpar = DFVegetationParameters(albedo=panel_79)  # -> veg_par; disabled; plug-in component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
boolean_toggle_15 = BooleanToggle(False)  # disabled
uwgsimpar = DFUWGSimulationParameter(run_period=analysisperiod_8.period, veg_par=vegetationpar, epw_site=refepwpar, bnd_layer=boundarylayer)  # -> sim_par; disabled; plug-in component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
runuwg = DFRunUrbanWeatherGenerator(model=modeluwg.model, epw_file=downloadepw_2.epw_file, sim_par=uwgsimpar, write=boolean_toggle_15, run=boolean_toggle_15)  # -> out, uwg_json, urban_epw; disabled; plug-in component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
panel_80 = Panel(runuwg.urban_epw)  # disabled

# ----
# Urban Heat Island - Adjusting vegetation
boolean_toggle_16 = BooleanToggle(True)
all_buildings_11 = Data([buildinguwg_9.building, buildinguwg_10.building, buildinguwg_8.building, buildinguwg_6.building, buildinguwg_11.building, buildinguwg_5.building])
context_2 = DFContextShade(geo=tree_coverage_added_3, uwg_is_veg=boolean_toggle_16)  # -> out, context; plug-in component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
model_2 = DFModel(buildings=flatten(all_buildings_11), context=flatten(context_2.context))  # -> out, model; plug-in component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
traffic_2 = DFTrafficParameters(watts_per_area="8")  # -> traffic; plug-in component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
terrain_2 = DFTerrain(terrain_geo=aoi_site_3, albedo="0.1", thickness="0.5")  # -> terrain; plug-in component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
modeluwg_2 = DFAssignModelUWGProperties(model=model_2.model, terrain=terrain_2, traffic=traffic_2, grass_cover=Slider(0.6, range=0..1))  # -> out, model; plug-in component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
panel_81 = Panel(modeluwg_2.out)
boundarylayer_2 = DFBoundaryLayerParameters()  # -> bnd_layer; plug-in component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
refepwpar_2 = DFReferenceEPWParameters()  # -> epw_site; plug-in component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
vegetationpar_2 = DFVegetationParameters(albedo=".5")  # -> veg_par; plug-in component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
boolean_toggle_17 = BooleanToggle(True)
uwgsimpar_2 = DFUWGSimulationParameter(run_period=analysisperiod_7.period, veg_par=vegetationpar_2, epw_site=refepwpar_2, bnd_layer=boundarylayer_2)  # -> sim_par; plug-in component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
runuwg_2 = DFRunUrbanWeatherGenerator(
    model=modeluwg_2.model,
    epw_file=downloadepw_3.epw_file,
    sim_par=uwgsimpar_2,
    write=boolean_toggle_17,
    run=boolean_toggle_17)  # -> out, uwg_json, urban_epw; plug-in component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
panel_82 = Panel(runuwg_2.urban_epw)

importepw_2 = LBImportEPW(epw_file=panel_80)  # -> location, dry_bulb_temperature, dew_point_temperature, relative_humidity, wind_speed, wind_direction, direct_normal_rad, diffuse_horizontal_rad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; disabled; plug-in component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
xdata_3 = LBDeconstructData(data=importepw_2.dry_bulb_temperature)  # -> header, values; disabled; plug-in component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
panel_83 = Panel("a>35")  # disabled
panel_84 = Panel("0,-1000,0")  # disabled
hourlyplot = LBHourlyPlot(data=importepw_2.dry_bulb_temperature, base_pt=panel_84, statement=panel_83)  # -> out, mesh, legend, borders, labels, title; disabled; plug-in component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
average_7 = Average(Input=xdata_3.values)  # disabled
panel_85 = Panel(average_7)  # disabled
boolean_toggle_18 = BooleanToggle(True)  # disabled
outdoorsolarmrt_2 = LBOutdoorSolarMRT(
    location=importepw_2.location,
    surface_temp=importepw_2.dry_bulb_temperature,
    dir_norm_rad=importepw_2.direct_normal_rad,
    diff_horiz_rad=importepw_2.diffuse_horizontal_rad,
    horiz_infrared=importepw_2.horizontal_infrared_rad,
    run=boolean_toggle_18)  # -> out, short_erf, long_erf, short_dmrt, long_dmrt, mrt; disabled; plug-in component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
boolean_toggle_19 = BooleanToggle(True)  # disabled
number_slider_16 = Slider(3, range=0..10)  # disabled
utci_2 = LBUTCIComfort(
    air_temp=importepw_2.dry_bulb_temperature,
    mrt=outdoorsolarmrt_2.mrt,
    rel_humid=importepw_2.relative_humidity,
    wind_vel=importepw_2.wind_speed,
    run=boolean_toggle_19)  # -> out, utci, comfort, condition, category, comf_obj; disabled; plug-in component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

panel_86 = Panel(xdata_3.values)  # disabled
applyper_2 = LBApplyAnalysisPeriod(data=utci_2.category, period=analysisperiod_12.period)  # -> data; disabled; plug-in component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
applyper_3 = LBApplyAnalysisPeriod(data=utci_2.utci, period=analysisperiod_12.period)  # -> data; disabled; plug-in component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

xdata_4 = LBDeconstructData(data=applyper_2)  # -> header, values; disabled; plug-in component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
larger_than = LargerThan(FirstNumber=xdata_4.values, SecondNumber=number_slider_16)  # -> LargerThan, OrEqualTo; disabled
xdata_5 = LBDeconstructData(data=applyper_3)  # -> header, values; disabled; plug-in component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
mass_addition = MassAddition(Input=larger_than.OrEqualTo)  # -> Result, PartialResults; disabled
panel_87 = Panel(xdata_4.values)  # disabled
panel_88 = Panel(larger_than.OrEqualTo)  # disabled
average_8 = Average(Input=xdata_5.values)  # disabled
panel_89 = Panel(mass_addition.Result)  # disabled
panel_90 = Panel(average_8)  # disabled

panel_91 = Panel(xdata_5.values)  # disabled

importepw_3 = LBImportEPW(epw_file=panel_82)  # -> location, dry_bulb_temperature, dew_point_temperature, relative_humidity, wind_speed, wind_direction, direct_normal_rad, diffuse_horizontal_rad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; plug-in component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
xdata_6 = LBDeconstructData(data=importepw_3.dry_bulb_temperature)  # -> header, values; plug-in component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
hourlyplot_2 = LBHourlyPlot(data=importepw_3.dry_bulb_temperature, base_pt="0,-1000,0", statement="a>35")  # -> out, mesh, legend, borders, labels, title; plug-in component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
average_9 = Average(Input=xdata_6.values)
panel_92 = Panel(average_9)
outdoorsolarmrt_3 = LBOutdoorSolarMRT(
    location=importepw_3.location,
    surface_temp=importepw_3.dry_bulb_temperature,
    dir_norm_rad=importepw_3.direct_normal_rad,
    diff_horiz_rad=importepw_3.diffuse_horizontal_rad,
    horiz_infrared=importepw_3.horizontal_infrared_rad,
    run=Toggle(True))  # -> out, short_erf, long_erf, short_dmrt, long_dmrt, mrt; plug-in component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
utci_3 = LBUTCIComfort(
    air_temp=importepw_3.dry_bulb_temperature,
    mrt=outdoorsolarmrt_3.mrt,
    rel_humid=importepw_3.relative_humidity,
    wind_vel=importepw_3.wind_speed,
    run=Toggle(True))  # -> out, utci, comfort, condition, category, comf_obj; plug-in component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

applyper_4 = LBApplyAnalysisPeriod(data=utci_3.category, period=analysisperiod_13.period)  # -> data; plug-in component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
applyper_5 = LBApplyAnalysisPeriod(data=utci_3.utci, period=analysisperiod_13.period)  # -> data; plug-in component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

xdata_7 = LBDeconstructData(data=applyper_4)  # -> header, values; plug-in component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
xdata_8 = LBDeconstructData(data=applyper_5)  # -> header, values; plug-in component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
larger_than_2 = LargerThan(FirstNumber=xdata_7.values, SecondNumber=Slider(3, range=0..10))  # -> LargerThan, OrEqualTo
average_10 = Average(Input=xdata_8.values)
mass_addition_2 = MassAddition(Input=larger_than_2.OrEqualTo)  # -> Result, PartialResults
panel_93 = Panel(average_10)
panel_94 = Panel(xdata_7.values)
panel_95 = Panel(larger_than_2.OrEqualTo)
panel_96 = Panel(mass_addition_2.Result)

importepw_4 = LBImportEPW(epw_file=downloadepw_2.epw_file)  # -> location, dry_bulb_temperature, dew_point_temperature, relative_humidity, wind_speed, wind_direction, direct_normal_rad, diffuse_horizontal_rad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; disabled; plug-in component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
xdata_9 = LBDeconstructData(data=importepw_4.dry_bulb_temperature)  # -> header, values; disabled; plug-in component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
panel_97 = Panel("0,-1150,0")  # disabled
panel_98 = Panel("a>35")  # disabled
hourlyplot_3 = LBHourlyPlot(data=importepw_4.dry_bulb_temperature, base_pt=panel_97, statement=panel_98)  # -> out, mesh, legend, borders, labels, title; disabled; plug-in component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
average_11 = Average(Input=xdata_9.values)  # disabled
boolean_toggle_20 = BooleanToggle(True)  # disabled
panel_99 = Panel(average_11)  # disabled
outdoorsolarmrt_4 = LBOutdoorSolarMRT(
    location=importepw_4.location,
    surface_temp=importepw_4.dry_bulb_temperature,
    dir_norm_rad=importepw_4.direct_normal_rad,
    diff_horiz_rad=importepw_4.diffuse_horizontal_rad,
    horiz_infrared=importepw_4.horizontal_infrared_rad,
    run=boolean_toggle_20)  # -> out, short_erf, long_erf, short_dmrt, long_dmrt, mrt; disabled; plug-in component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
boolean_toggle_21 = BooleanToggle(True)  # disabled
utci_4 = LBUTCIComfort(
    air_temp=importepw_4.dry_bulb_temperature,
    mrt=outdoorsolarmrt_4.mrt,
    rel_humid=importepw_4.relative_humidity,
    wind_vel=importepw_4.wind_speed,
    run=boolean_toggle_21)  # -> out, utci, comfort, condition, category, comf_obj; disabled; plug-in component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

panel_100 = Panel(utci_4.utci)  # disabled
applyper_6 = LBApplyAnalysisPeriod(data=utci_4.category, period=analysisperiod_11.period)  # -> data; disabled; plug-in component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
applyper_7 = LBApplyAnalysisPeriod(data=utci_4.utci, period=analysisperiod_11.period)  # -> data; disabled; plug-in component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
xdata_10 = LBDeconstructData(data=applyper_6)  # -> header, values; disabled; plug-in component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

larger_than_3 = LargerThan(FirstNumber=xdata_10.values, SecondNumber=Slider(3, range=0..10))  # -> LargerThan, OrEqualTo; disabled
xdata_11 = LBDeconstructData(data=applyper_7)  # -> header, values; disabled; plug-in component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
panel_101 = Panel(larger_than_3.OrEqualTo)  # disabled
mass_addition_3 = MassAddition(Input=larger_than_3.OrEqualTo)  # -> Result, PartialResults; disabled
panel_102 = Panel(xdata_11.values)  # disabled
panel_103 = Panel(mass_addition_3.Result)  # disabled

panel_104 = Panel(xdata_10.values)  # disabled
average_12 = Average(Input=xdata_11.values)  # disabled
panel_105 = Panel(average_12)  # disabled

panel_106 = Panel(panel_103)  # disabled
panel_107 = Panel(panel_89)  # disabled
subtraction = Subtraction(A=panel_107, B=panel_106)  # disabled
panel_108 = Panel(subtraction)  # disabled

importepw_5 = LBImportEPW(epw_file=downloadepw_3.epw_file)  # -> location, dry_bulb_temperature, dew_point_temperature, relative_humidity, wind_speed, wind_direction, direct_normal_rad, diffuse_horizontal_rad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; plug-in component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
xdata_12 = LBDeconstructData(data=importepw_5.dry_bulb_temperature)  # -> header, values; plug-in component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
hourlyplot_4 = LBHourlyPlot(data=importepw_5.dry_bulb_temperature, base_pt="0,-1150,0", statement="a>35")  # -> out, mesh, legend, borders, labels, title; plug-in component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
average_13 = Average(Input=xdata_12.values)
panel_109 = Panel(average_13)
outdoorsolarmrt_5 = LBOutdoorSolarMRT(
    location=importepw_5.location,
    surface_temp=importepw_5.dry_bulb_temperature,
    dir_norm_rad=importepw_5.direct_normal_rad,
    diff_horiz_rad=importepw_5.diffuse_horizontal_rad,
    horiz_infrared=importepw_5.horizontal_infrared_rad,
    run=Toggle(True))  # -> out, short_erf, long_erf, short_dmrt, long_dmrt, mrt; plug-in component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
utci_5 = LBUTCIComfort(
    air_temp=importepw_5.dry_bulb_temperature,
    mrt=outdoorsolarmrt_5.mrt,
    rel_humid=importepw_5.relative_humidity,
    wind_vel=importepw_5.wind_speed,
    run=Toggle(True))  # -> out, utci, comfort, condition, category, comf_obj; plug-in component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

applyper_8 = LBApplyAnalysisPeriod(data=utci_5.category, period=analysisperiod_10.period)  # -> data; plug-in component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
applyper_9 = LBApplyAnalysisPeriod(data=utci_5.utci, period=analysisperiod_10.period)  # -> data; plug-in component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

xdata_13 = LBDeconstructData(data=applyper_8)  # -> header, values; plug-in component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
larger_than_4 = LargerThan(FirstNumber=xdata_13.values, SecondNumber=Slider(3, range=0..10))  # -> LargerThan, OrEqualTo
panel_110 = Panel(xdata_13.values)
panel_111 = Panel(larger_than_4.OrEqualTo)
mass_addition_4 = MassAddition(Input=larger_than_4.OrEqualTo)  # -> Result, PartialResults
panel_112 = Panel(mass_addition_4.Result)

xdata_14 = LBDeconstructData(data=applyper_9)  # -> header, values; plug-in component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
panel_113 = Panel(utci_5.utci)
panel_114 = Panel(xdata_14.values)
average_14 = Average(Input=xdata_14.values)
panel_115 = Panel(average_14)

panel_116 = Panel(panel_112)
panel_117 = Panel(panel_96)
subtraction_2 = Subtraction(A=panel_117, B=panel_116)
panel_118 = Panel(subtraction_2)
